% Simulink data dictionary UAM_data.sldd

SensorAAFiltNum = 4386000
SensorAAFiltDen = [1 2960 4386000]

UAVPathManagerBus = Simulink.Bus()
  mode: uint8
  position: double[3 1]
  params: double[4 1]

RotorParameters = Simulink.Bus()
  w1: double
  w2: double
  w3: double
  w4: double
  c1: double
  c2: double

StateBus = Simulink.Bus()
  course: double
  gndspeed: double
  airspeed: double
  Xe: double[3 1]
  Ve: double[3 1]
  DCMbe: double[3 3]
  q: double[1 4]
  pqr: double[3 1]
  Vb: double[1 3]
  Abb: double[1 3]
  Abe: double[1 3]
  Euler: double[3 1]
  RotorParameters: Bus: RotorParameters
  ypr: double[3 1]
  Ve_ground: double[3 1]

sensorData = Simulink.Bus()
  GPSCourse: double
  gndspeed: double
  DiffPress: double
  rho: double
  LLA: double[1 3]
  Abb: double[1 3]
  Gyro: double[1 3]
  Mag: double[1 3]
  GPSVelocity: double[1 3]
  Abe: double[1 3]
  RotorParameters: Bus: RotorParameters